# Grasshopper definition tutorials.gh (Grasshopper 1.0.8)
# plug-ins: RhinoCodePluginGH, Human UI, Hops

回転１ = Slider(0.26, range=0..1)
回転２ = Slider(0.68, range=0..1)
高さ１ = Slider(0.29, range=0..1)
高さ2 = Slider(0.54, range=0..1)
傾き１ = Slider(0.69, range=0..1)
傾き２ = Slider(0.23, range=0..1)

# ---- group: 初期化
button = Button()

# ---- group: 抽選
py3 = Python3Script(x=Toggle(True))  # -> out
# ---------- py3: Python ----------
import random
if x:
    a = random.randint(1,2)
    if a == 1:
        print("ベイズ式→スライダ式")
    elif a == 2:
        print("スライダ式→ベイズ式")
else:
    print("waiting...")
# ---------- end py3 ----------
panel = Panel(py3)

# ----
panel_2 = Panel("終了判定：85点以上3エポック進んでも案の評価点が上がらなかった場合。")
panel_3 = Panel("最終案：1位を選ぶ。")

# ----
# 評価プール
genes = GenePool(Decimals=0, Maximum=100, Minimum=1, Value=[50, 50.5, 50.5, 50.5, 50.5, 50.5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])

# ---- group: GUI表示
toggle = BooleanToggle(True)

# ---- group: 更新
button_2 = Button(ExpressionNormal="True", ExpressionPressed="False")

# ----
hops = Hops(
    Dim="6",
    Update=button_2,
    Reset=button,
    CacheResultsInMemory=False,
    CacheSolveResults=False,
    RemoteDefinitionLocation="http://127.0.0.1:5000/get_points",
    RemoteSolveVersion=(0, 1, 0),
    ShowInput_Enabled=False,
    ShowInput_Path=False,
    SynchronousSolve=True)
partition = PartitionList(List=hops, Size="6")

# ---- group: 処理開始
button_3 = Button()

# ----
remap = RemapNumbers(Value=回転１, Source=Domain(0, 1), Target="0 to 60")  # -> simplify(graft(Mapped)), Clipped
remap_2 = RemapNumbers(Value=回転２, Source=Domain(0, 1), Target="0 to 60")  # -> simplify(graft(Mapped)), Clipped
remap_3 = RemapNumbers(Value=高さ１, Source=Domain(0, 1), Target="0 to 1")  # -> simplify(graft(Mapped)), Clipped
remap_4 = RemapNumbers(Value=高さ2, Source=Domain(0, 1), Target="0 to 1")  # -> simplify(graft(Mapped)), Clipped
remap_5 = RemapNumbers(Value=傾き１, Source=Domain(0, 1), Target="0 to 100")  # -> simplify(graft(Mapped)), Clipped
remap_6 = RemapNumbers(Value=傾き２, Source=Domain(0, 1), Target="0 to 100")  # -> simplify(graft(Mapped)), Clipped
pp = ParametricPavilion(
    pt="{0,0,0}",
    c1_degree=remap.Mapped,
    c2_degree=remap_2.Mapped,
    c1_high=remap_3.Mapped,
    c2_high=remap_4.Mapped,
    c2_right=remap_5.Mapped,
    c2_left=remap_6.Mapped)
mplane = MeshPlane(Boundary={Plane=PlaneXY(0, 0, 0), Size=Domain2(u=-10..10, v=-10..10)}, WidthCount=10, HeightCount=10)  # -> Mesh, Area
_3dview = Create3DView(
    MeshToDisplay=mplane.Mesh,
    MeshColors=RGB(255, 0, 0),
    ViewWidth=Slider(500, range=0..1000),
    ViewHeight=Slider(500, range=0..1000))  # -> flatten(_3DView)
launchwin = LaunchWindow(
    Show=Toggle(True),
    Name="Control Window",
    Width=Slider(550, range=0..2000),
    Height=Slider(550, range=0..1000),
    ChildStatus=2,
    EnableHorizScroll=False)
set3dview = Set3DView(_3DView=_3dview, MeshToDisplay=pp)
addelems = AddElements(Window=launchwin, Elements=flatten(_3dview), DoVLChecking=True)  # -> AddedElements, ElementNames

item = ListItem(List=partition, Index=0, Wrap=True)  # -> Item, Item1, Item2, Item3, Item4, Item5
remap_7 = RemapNumbers(Value=item.Item, Source=Domain(0, 1), Target="0 to 60")  # -> simplify(graft(Mapped)), Clipped
remap_8 = RemapNumbers(Value=item.Item1, Source=Domain(0, 1), Target="0 to 60")  # -> simplify(graft(Mapped)), Clipped
remap_9 = RemapNumbers(Value=item.Item3, Source=Domain(0, 1), Target="0 to 1")  # -> simplify(graft(Mapped)), Clipped
remap_10 = RemapNumbers(Value=item.Item4, Source=Domain(0, 1), Target="0 to 100")  # -> simplify(graft(Mapped)), Clipped
remap_11 = RemapNumbers(Value=item.Item5, Source=Domain(0, 1), Target="0 to 100")  # -> simplify(graft(Mapped)), Clipped
remap_12 = RemapNumbers(Value=item.Item2, Source=Domain(0, 1), Target="0 to 1")  # -> simplify(graft(Mapped)), Clipped

lng = ListLength(List=flatten(item.Item5))

grid_place = GridPlace(list_length=lng, num_2=Slider(500, range=0..10000), num=Slider(6, range=0..10))  # -> simplify(pt_3)

# ---- group: Create
button_4 = Button()

# ----
subtraction = Subtraction(A=lng, B="1")
dom = ConstructDomain(DomainStart=0, DomainEnd=subtraction)
subset = SubList(List=genes, Domain=dom, Wrap=True)  # -> List, Index
division = Division(A=subset.List, B="100")
hops_2 = Hops(
    Y=division,
    Run=button_3,
    Create0Img=button_4,
    CacheResultsInMemory=False,
    CacheSolveResults=False,
    RemoteDefinitionLocation="http://127.0.0.1:5000/single_model_loop",
    RemoteSolveVersion=(0, 1, 0),
    ShowInput_Enabled=False,
    ShowInput_Path=False,
    SynchronousSolve=True)

pp_2 = ParametricPavilion(
    pt=grid_place,
    c1_degree=remap_7.Mapped,
    c2_degree=remap_8.Mapped,
    c1_high=remap_12.Mapped,
    c2_high=remap_9.Mapped,
    c2_right=remap_10.Mapped,
    c2_left=remap_11.Mapped)  # -> simplify(geo_2)

button_5 = CreateButton(ButtonName="戻る", ButtonStyle=0)
button_6 = CreateButton(ButtonName="次へ", ButtonStyle=0)

circle = Circle(Plane=PlaneXY(0, 0, 0), Radius=100)

values = ValueListener(Elements=button_5, SomeProperty=True)  # -> Values, Indices
values_2 = ValueListener(Elements=button_6, SomeProperty=True)  # -> Values, Indices
rec = DataRecorder(values_2.Values, DataLimit=-10, RecordData=True)
rec_2 = DataRecorder(values.Values, DataLimit=-10, RecordData=True)
ma = MassAddition(Input=rec)  # -> Result, PartialResults
ma_2 = MassAddition(Input=rec_2)  # -> Result, PartialResults
subtraction_2 = Subtraction(A=ma.Result, B=ma_2.Result, C="0")

label = CreateLabel(LabelSize=Slider(52, range=0..100), Justification=0)
item_2 = ListItem(List=genes, Index=subtraction_2, Wrap=True)
py3_2 = Python3Script(x=item_2)  # -> a
# ---------- py3_2: Python ----------
"""Grasshopper Script"""
a = str(int(x)) + "点"
# ---------- end py3_2 ----------
setlabel = SetLabelContents(LabelToModify=label, NewLabelContents=py3_2)

_3dview_2 = Create3DView(
    MeshToDisplay=circle,
    MeshColors=RGB(255, 0, 0),
    ViewWidth=Slider(600, range=0..1000),
    ViewHeight=Slider(570, range=0..1000))  # -> flatten(_3DView)
tstat = TreeStatistics(Tree=pp_2)  # -> Paths, Length, Count
py3_3 = Python3Script(x=tstat.Count, y=subtraction_2)  # -> out, a
# ---------- py3_3: Python ----------
if x > y >= 0:
    a = "{0;1}"
else:
    a = "{0;0}"
# ---------- end py3_3 ----------
branch = TreeBranch(
    Tree=[remap_7.Mapped, remap_8.Mapped, remap_12.Mapped, remap_9.Mapped, remap_10.Mapped, remap_11.Mapped],
    Path=tstat.Paths,
    MaintainPaths=True)
branch_2 = TreeBranch(Tree=pp_2, Path=subtraction_2, MaintainPaths=True)
item_3 = ListItem(List=branch, Index=0, Wrap=True)  # -> Item, Item1, Item2, Item3, Item4, Item5
preview = CustomPreview(
    Geometry=branch_2,
    Material={diffuse=RGB(221, 160, 221), emission=RGB(66, 48, 66), shine=0.5, specular=RGB(255, 255, 255), transparency=0})
pp_3 = ParametricPavilion(
    pt="{0,0,0}",
    c1_degree=item_3.Item,
    c2_degree=item_3.Item1,
    c1_high=item_3.Item2,
    c2_high=item_3.Item3,
    c2_right=item_3.Item4,
    c2_left=item_3.Item5)

entwine = Entwine(Branch00=circle, Branch01=pp_3, FlattenInputs=True)
tree_branch = TreeBranch(Tree=entwine, Path=py3_3.a, MaintainPaths=True)

set3dview_2 = Set3DView(_3DView=_3dview_2, MeshToDisplay=tree_branch)

hops_3 = Hops(
    CacheResultsInMemory=False,
    CacheSolveResults=False,
    RemoteDefinitionLocation="http://127.0.0.1:5000/get_img_path",
    RemoteSolveVersion=(0, 1, 0),
    ShowInput_Enabled=False,
    ShowInput_Path=False,
    SynchronousSolve=True)
py3_4 = Python3Script(x=subtraction_2, y=hops_3)  # -> a
# ---------- py3_4: Python ----------
"""Grasshopper Script"""

if x < 12:
    a = y + f"\{0}.png"
else:
    a = y + f"\{str(x)}.png"
# ---------- end py3_4 ----------

join = TextJoin(Text=[hops_3, "\\0.png"])

image = CreateImage(ImageSource=join, ImageWidth=Slider(534, range=500..2000))
scrollviewer = CreateScrollViewer(
    UIElements=image,
    HorizontalScrollBarVisibility=0,
    VerticalScrollBarVisibility=0,
    Width=Slider(606, range=0..1000),
    Height=Slider(618, range=0..1000))
setimg = SetImage(ImageToModify=image, NewImagePath=py3_4)

launchwin_2 = LaunchWindow(
    Show=toggle,
    Name="Control Window",
    Width=Slider(1300, range=0..2000),
    Height=Slider(760, range=0..1000),
    ChildStatus=1,
    EnableHorizScroll=False)

merge = Merge(Data1=button_5, Data2=_3dview_2, Data3=button_6, Data4=scrollviewer)
stack = CreateStack(UIElements=merge, Horizontal=True)

py3_5 = Python3Script(x="design", y=subtraction_2)  # -> a
# ---------- py3_5: Python ----------
"""Grasshopper Script"""
a = x + " " + str(int(y))
# ---------- end py3_5 ----------
tabs = TabbedView(TabNames="design", TabTextSize=Slider(50, range=0..100), Tab0=flatten(stack))
adjustpos = AdjustElementPositioning(ElementsToAdjust=tabs, AbsolutePositioning=False, Width=Slider(426, range=0..1000))
settab = SetTabbedView(TabbedView=tabs, TabNames=py3_5)

merge_2 = Merge(Data1=tabs, Data2=label)
stack_2 = CreateStack(UIElements=merge_2, Horizontal=True)
merge_3 = Merge(Data1=stack_2, Data2=stack)

addelems_2 = AddElements(Window=launchwin_2, Elements=flatten(merge_3), DoVLChecking=True)  # -> AddedElements, ElementNames

# ==== cluster GridPlace
list_length = ClusterInput()
num = ClusterInput()
num_2 = ClusterInput()
number_slider = Slider(100, range=0..100)
num_3 = Number(num)
num_4 = Number(num_2)
series = Series(Start=0, Step=1, Count=number_slider)  # -> graft(Series)
series_2 = Series(Start=0, Step=1, Count=num_3)
multiplication = Multiplication(A=number_slider, B=num_3)
multiplication_2 = Multiplication(A=series, B=num_4)
multiplication_3 = Multiplication(A=series_2, B=num_4)
subtraction = Subtraction(A=multiplication, B=list_length)
number_slider_2 = Slider(-200, range=-1000..1000)
series_3 = Series(Start=0, Step=1, Count=list_length)
pt = ConstructPoint(XCoordinate=multiplication_2, YCoordinate=multiplication_3, ZCoordinate=0)  # -> flatten(Point)
series_4 = Series(Start=list_length, Step=1, Count=subtraction)
cull_i = CullIndex(List=pt, Indices=series_4, Wrap=True)
Y = UnitY(Factor=number_slider_2)
X = UnitX(Factor=number_slider_2)
addition = Addition(A=X, B=Y)
pt_2 = Point(graft(cull_i))
move = Move(Geometry=pt_2, Motion=addition)  # -> Geometry, Transform
pt_3 = ClusterOutput(pt_2)
tag = TextTag(Location=flatten(move.Geometry), Text=series_3)

# ==== cluster ParametricPavilion
pt = ClusterInput()
pt_2 = Point(pt)
c2_high = ClusterInput()
pt_3 = ConstructPoint(XCoordinate=0, YCoordinate=0, ZCoordinate=0)
c1_degree = ClusterInput()
c2_right = ClusterInput()
c2_degree = ClusterInput()
c1_high = ClusterInput()
c2_left = ClusterInput()
lng = ListLength(List=flatten(pt_2))
num = Number(c2_high)
num_2 = Number(c1_degree)
repeat = RepeatData(Data=pt_3, Length=lng)
num_3 = Number(c2_right)
num_4 = Number(c2_degree)
num_5 = Number(c1_high)
num_6 = Number(c2_left)
vec = Vector(graft(pt_2))

Z = UnitZ(Factor=Slider(1, range=0..100))
cir = Circle(Plane=repeat, Radius=Slider(10, range=0..100))
move = Move(Geometry=cir, Motion=Z)  # -> Geometry, Transform
area = Area(Geometry=cir)  # -> Area, Centroid
multiplication = Multiplication(A=Slider(30, range=0..100), B="2")
area_2 = Area(Geometry=move.Geometry)  # -> Area, Centroid
addition = Addition(A=multiplication, B="1")
scale = Scale(Geometry=cir, Center=area.Centroid, Factor=Slider(12, range=0..100))  # -> Geometry, Transform
scale_2 = Scale(Geometry=move.Geometry, Center=area_2.Centroid, Factor=Slider(5.1, range=0..10))  # -> Geometry, Transform
divide = DivideCurve(Curve=scale_2.Geometry, Count=addition, Kinks=False)  # -> Points, Tangents, Parameters
divide_2 = DivideCurve(Curve=scale.Geometry, Count=addition, Kinks=False)  # -> Points, Tangents, Parameters
divide_3 = DivideCurve(Curve=cir, Count=addition, Kinks=False)  # -> Points, Tangents, Parameters
pt_4 = ConstructPoint(XCoordinate=0, YCoordinate=0, ZCoordinate=0)
vec2pt = Vector2Pt(PointA=divide_2.Points, PointB=divide_3.Points, Unitize=False)  # -> Vector, Length
vec2pt_2 = Vector2Pt(PointA=pt_4, PointB=divide_3.Points, Unitize=False)  # -> Vector, Length
amp = Amplitude(Vector=vec2pt.Vector, Amplitude=Slider(48, range=0..1000))
amp_2 = Amplitude(Vector=vec2pt_2.Vector, Amplitude=Slider(40, range=0..1000))
neg = Negative(Value=amp)
neg_2 = Negative(Value=amp_2)

lng_2 = ListLength(List=divide.Points)
division = Division(A=lng_2, B="2")
subtraction = Subtraction(A=division, B="1")
range = Range(Domain=Domain(0, 1), Steps=subtraction)
graph = GraphMapper(range, x0=0, x1=1, y0=0, y1=1, container_name="Bezier", cpx=[0, 0.5159956217, 0.500951767, 1], cpy=[0, 0, 1, 1])
dom = ConstructDomain(DomainStart=num_3, DomainEnd=num_6)
bnd = Bounds(Numbers=graph)
remap = RemapNumbers(Value=graph, Source=bnd, Target=dom)  # -> Mapped, Clipped
rev = ReverseList(List=remap.Clipped)
cull_i = CullIndex(List=rev, Indices="0", Wrap=True)

trim = TrimTree(Tree=cull_i, Depth=1)

merge = Merge(Data1=remap.Mapped, Data2=trim)

addition_2 = Addition(A=merge, B=Slider(4, range=0..100))
multiplication_2 = Multiplication(A=addition_2, B=Slider(2, range=0..10))
shift = ShiftList(List=multiplication_2, Shift=Slider(12, range=0..100), Wrap=True)
Z_2 = UnitZ(Factor=shift)
move_2 = Move(Geometry=divide.Points, Motion=Z_2)  # -> Geometry, Transform
bzspan = BezierSpan(StartPoint=move_2.Geometry, StartTangent=neg, EndPoint=divide_2.Points, EndTangent=amp)  # -> reparameterize(Curve), Length, Domain
bzspan_2 = BezierSpan(StartPoint=move_2.Geometry, StartTangent=neg_2, EndPoint=divide_3.Points, EndTangent=amp_2)  # -> reparameterize(Curve), Length, Domain
end = EndPoints(Curve=bzspan.Curve)  # -> Start, End
intcrv = Interpolate(Vertices=end.Start, Degree=3, Periodic=True, KnotStyle=1)  # -> Curve, Length, Domain
pipe = Pipe(Curve=intcrv.Curve, Radius="1", Caps=0)

trim_2 = TrimTree(Tree=pipe, Depth=3)

lng_3 = ListLength(List=bzspan_2.Curve)
division_2 = Division(A=lng_3, B="2")
subtraction_2 = Subtraction(A=division_2, B="1")
range_2 = Range(Domain=Domain(0, 1), Steps=subtraction_2)
graph_2 = GraphMapper(range_2, x0=0, x1=1, y0=0, y1=1, container_name="Bezier", cpx=[0, 0.5059779286, 0.512319386, 1], cpy=[0, 0, 1, 1])
dom_2 = ConstructDomain(DomainStart=num, DomainEnd=Slider(0.99, range=0..1))
bnd_2 = Bounds(Numbers=graph_2)
remap_2 = RemapNumbers(Value=graph_2, Source=bnd_2, Target=dom_2)  # -> Mapped, Clipped
rev_2 = ReverseList(List=remap_2.Clipped)
cull_i_2 = CullIndex(List=rev_2, Indices="0", Wrap=True)

trim_3 = TrimTree(Tree=cull_i_2, Depth=1)

merge_2 = Merge(Data1=remap_2.Mapped, Data2=trim_3)

lng_4 = ListLength(List=bzspan.Curve)
division_3 = Division(A=lng_4, B="2")
subtraction_3 = Subtraction(A=division_3, B="1")
range_3 = Range(Domain=Domain(0, 1), Steps=subtraction_3)
graph_3 = GraphMapper(range_3, x0=0, x1=1, y0=0, y1=1, container_name="Bezier", cpx=[0, 0.5159956217, 0.500951767, 1], cpy=[0, 0, 1, 1])
dom_3 = ConstructDomain(DomainStart=Slider(0.99, range=0..1), DomainEnd=num_5)
bnd_3 = Bounds(Numbers=graph_3)
remap_3 = RemapNumbers(Value=graph_3, Source=bnd_3, Target=dom_3)  # -> Mapped, Clipped
rev_3 = ReverseList(List=remap_3.Clipped)
cull_i_3 = CullIndex(List=rev_3, Indices="0", Wrap=True)

trim_4 = TrimTree(Tree=cull_i_3, Depth=1)

merge_3 = Merge(Data1=remap_3.Mapped, Data2=trim_4)

shift_2 = ShiftList(List=merge_3, Shift=num_2, Wrap=True)
shift_3 = ShiftList(List=merge_2, Shift=num_4, Wrap=True)
shatter = Shatter(Curve=graft(bzspan.Curve), Parameters=graft(shift_2))
shatter_2 = Shatter(Curve=graft(bzspan_2.Curve), Parameters=graft(shift_3))
item = ListItem(List=shatter, Index=0, Wrap=True)  # -> Item, Item1
item_2 = ListItem(List=shatter_2, Index=0, Wrap=True)  # -> Item, Item1

end_2 = EndPoints(Curve=item_2.Item)  # -> Start, End
offcrv = OffsetCurve(
    Curve=item_2.Item,
    Plane=PlaneXY(0, 0, 0),
    Distance=Slider(0.5, range=0..1),
    BothSides=Toggle(True),
    Kinks=0,
    CapType="0")
item_3 = ListItem(List=offcrv, Index=0, Wrap=True)  # -> Item, Item1
rulesrf = RuledSurface(CurveA=item_3.Item, CurveB=item_3.Item1)

trim_5 = TrimTree(Tree=end_2.End, Depth=2)

intcrv_2 = Interpolate(Vertices=trim_5, Degree=3, Periodic=True, KnotStyle=1)  # -> Curve, Length, Domain

offset = OffsetSurface(Surface=rulesrf, Distance=0, Retrim=True)
pipe_2 = Pipe(Curve=intcrv_2.Curve, Radius="1", Caps=0)

end_3 = EndPoints(Curve=item.Item)  # -> Start, End
offcrv_2 = OffsetCurve(Curve=item.Item, Plane=PlaneXY(0, 0, 0), Distance=Slider(0.5, range=0..1), BothSides=Toggle(True), Kinks=0, CapType="0")
item_4 = ListItem(List=offcrv_2, Index=0, Wrap=True)  # -> Item, Item1
rulesrf_2 = RuledSurface(CurveA=item_4.Item, CurveB=item_4.Item1)

trim_6 = TrimTree(Tree=end_3.End, Depth=2)

intcrv_3 = Interpolate(Vertices=trim_6, Degree=3, Periodic=True, KnotStyle=1)  # -> Curve, Length, Domain

pipe_3 = Pipe(Curve=intcrv_3.Curve, Radius="1", Caps=0)
offset_2 = OffsetSurface(Surface=rulesrf_2, Distance=0, Retrim=True)

trim_7 = TrimTree(Tree=offset_2, Depth=7)
trim_8 = TrimTree(Tree=pipe_3, Depth=5)
trim_9 = TrimTree(Tree=pipe_2, Depth=5)
trim_10 = TrimTree(Tree=offset, Depth=7)
merge_4 = Merge(Data1=trim_2, Data2=trim_7, Data3=trim_8, Data4=trim_10, Data5=trim_9)
move_3 = Move(Geometry=merge_4, Motion=vec)  # -> Geometry, Transform
geo = Geometry(move_3.Geometry)

geo_2 = ClusterOutput(geo)
